% Simulink data dictionary temperatureControlledSystem.sldd

OFF = Simulink.Parameter(0, DataType="boolean")
ON = Simulink.Parameter(1, DataType="boolean")
TEMPMAX = Simulink.Parameter(25, DataType="int8")
TEMPMIN = Simulink.Parameter(10, DataType="int8")
TIMER = Simulink.Parameter(5, DataType="uint8")